# Grasshopper definition solarAnalysis.gh (Grasshopper 1.0.7)
# plug-ins: BH.UI.Grasshopper, ggRhinoIFC

ladybug = Ladybug_Ladybug()  # -> Vviiiiiiiiiizzz; plug-in component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
number_slider = Slider(1, range=0..1)  # disabled
number_slider_2 = Slider(36.61256, range=-180..180)
number_slider_3 = Slider(40.5953, range=-90..90)
number_slider_4 = Slider(2, range=0..10)
constructlocation = Ladybug_ConstructLocation(
    locationName="unknown_Location",
    latitude=number_slider_3,
    longitude=number_slider_2,
    timeZone=number_slider_4,
    elevation=0)  # -> location; disabled; plug-in component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
number_slider_5 = Slider(11, range=0..100)
number_slider_6 = Slider(2020, range=0..10000)
number_slider_7 = Slider(10, range=1..31)
sunpath = Ladybug_SunPath(
    location=constructlocation,
    hour=number_slider_5,
    day=number_slider_7,
    month=12,
    timeStep=1,
    sunPathScale=number_slider,
    dailyOrAnnualSunPath=True)  # -> readMe, sunVectors, sunAltitudes, sunAzimuths, port, sunSpheresMesh, sunPathCrvs, compassCrvs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; disabled; plug-in component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
location = Location(
    Latitude=number_slider_3,
    Longitude=number_slider_2,
    Elevation=0,
    UtcOffset=number_slider_4,
    Name="Kyiv",
    Component="BH.oM.Environment.Climate.Location")
createcustom = CreateCustom(Component="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")
spacetime = SpaceTime(
    Location="{ \"_t\" : \"BH.oM.Environment.Climate.Location\", \"BHoM_Guid\" : \"639ae935-0402-4b60-9083-8540a513e60b\", \"Name\" : \"\", \"Fragments\" : [], \"Tags\" : [], \"CustomData\" : { }, \"Latitude\" : 0.0, \"Longitude\" : 0.0, \"Elevation\" : 0.0, \"UtcOffset\" : 0.0 }",
    Year=Slider(2020, range=0..10000),
    Month=[Slider(5, range=0..10), Slider(7, range=0..10)],
    Day=1,
    Hour=0,
    Minute=0,
    Second=0,
    Millisecond=0,
    Component="BH.oM.Environment.Climate.SpaceTime")
geo = Geometry(sunpath.sunPathCrvs)  # disabled
explode = Explode(Object=location, Component="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")  # -> Latitude, Longitude, Elevation, UtcOffset, BHoM_Guid, Name, Fragments, Tags, CustomData
spacetime_2 = SpaceTime(
    Location=location,
    Year=number_slider_6,
    Month=Slider(3, range=1..12),
    Day=number_slider_7,
    Hour=number_slider_5,
    Minute=0,
    Component="BH.oM.Environment.Climate.SpaceTime")
spacetime_3 = SpaceTime(
    Location=location,
    Year=number_slider_6,
    Month=Slider(5, range=1..12),
    Day=number_slider_7,
    Hour=Slider(13, range=0..100),
    Minute=0,
    Component="BH.oM.Environment.Climate.SpaceTime")
c_script = CSharpScript(
    x=location,
    Reference=["C:\Users\m.holovko\AppData\Roaming\BHoM\Assemblies\Environment_oM.dll", "C:\Users\m.holovko\AppData\Roaming\BHoM\Assemblies\BHoM.dll"])  # -> out, A
# ---------- c_script: C# usings ----------
using BH.oM.Environment;
# ---------- c_script: C# ----------
    var z = (BH.oM.Environment.Climate.Location) x;
    z.Latitude
    A = z;
# ---------- end c_script ----------
merge = Merge(Data1=Slider(1, range=0..1), Data2=Slider(2, range=0..10))
analysisperiod = AnalysisPeriod(SpaceTimeStart=spacetime_2, SpaceTimeEnd=spacetime_3, Component="{ .AnalysisPeriod")
panel = Panel(explode.Name)
cir = Circle(Plane=PlaneXY(0, 0, 0), Radius=1)
spacetime_4 = SpaceTime(
    Location="{ \"_t\" : \"BH.oM.Environment.Climate.Location\", \"BHoM_Guid\" : \"639ae935-0402-4b60-9083-8540a513e60b\", \"Name\" : \"\", \"Fragments\" : [], \"Tags\" : [], \"CustomData\" : { }, \"Latitude\" : 0.0, \"Longitude\" : 0.0, \"Elevation\" : 0.0, \"UtcOffset\" : 0.0 }",
    Year=1900,
    Month=merge,
    Day=Slider(2, range=0..10),
    Hour=0,
    Minute=0,
    Second=0,
    Millisecond=0,
    Component="BH.oM.Environment.Climate.SpaceTime")
explode_2 = Explode(Object=analysisperiod, Component="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")  # -> StartTime, EndTime, Type, BHoM_Guid, Name, Fragments, Tags, CustomData
explode_3 = Explode(Object=analysisperiod, Component="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")  # -> StartTime, EndTime, Type, BHoM_Guid, Name, Fragments, Tags, CustomData
getproperty = GetProperty(PropName="Azimuth", Component="{ .GetProperty")
explode_4 = Explode(Object=explode_3.EndTime, Component="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")  # -> Location, Year, Month, Day, Hour, Minute, Second, Millisecond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
panel_2 = Panel(explode_2.Type)
panel_3 = Panel(explode_4.Month)
number_slider_8 = Slider(200, range=0..1000)
area = Area(UseTasks=True)  # -> Area, Centroid
line = LineSDL(Start="0,0,0", Direction=Vector(0, 0, 1), Length=Slider(500, range=0..1000))
solarpa = SolarPA(Component="{ .SolarPA")
dailypath = DailyPath(Component="{ .DailyPath")
mounthpaths = MounthPaths(Component="{ .MounthPaths")
hourpath = HourPath(Component="{ .HourPath")
explode_5 = Explode(Object=solarpa, Component="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")  # -> Azimuth, Altitude, Sunrise, Sunset, BHoM_Guid, Name, Fragments, Tags, CustomData; disabled
xy = XYPlane(Origin=Point(0, 0, 0))  # disabled
crv = Curve(hourpath)  # disabled
solarvector = SolarVector(Sun=solarpa, Component="{ .SolarVector")  # disabled
cp = ControlPoints(Curve=crv)  # -> Points, Weights, Knots; disabled
convert = Convert(Component="{ \"SelectedItem\" : null, \"InputParams\" : [], \"OutputParams\" : [], \"BHoM_Guid\" : \"b7ee83a9-e041-4367-a0cf-59ed4a04a07a\" }")  # disabled
pcx = CurvePlane(Curve=graft(hourpath), Plane=xy)  # -> Points, ParamsC, ParamsP; disabled
shatter = Shatter(Curve=graft(hourpath), Parameters=pcx.ParamsC)  # disabled
pt = Point(solarvector)  # disabled
solarpa_2 = SolarPA(Component="{ .SolarPA")  # disabled
pshift = ShiftPaths(Data=shatter, Offset=-1)  # disabled
item = ListItem(List=pshift, Index=0, Wrap=True)  # disabled
ggifckw = GgIFCGetKeyword()
